% Simulink data dictionary modelconfig.sldd

tSSlow = 0.04
tS_Speedgoat = 0.004
tS_RasperryPi = 0.02
tS_GRT = Simulink.Parameter(0.004)
Speedgoat = Simulink.ConfigSet(StartTime="0", StopTime="inf", FixedStep="tS", Solver="FixedStepDiscrete", ProdHWDeviceType="Generic->32-bit x86 compatible", SystemTargetFile="slrt.tlc", TargetLang="C")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
GRT = Simulink.ConfigSet(StartTime="0", StopTime="inf", FixedStep="tS", Solver="FixedStepDiscrete", ProdHWDeviceType="Generic->32-bit x86 compatible", SystemTargetFile="grt.tlc", TargetLang="C")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
RasperryPi = Simulink.ConfigSet(StartTime="0", StopTime="600", FixedStep="tS", Solver="FixedStepDiscrete", ProdHWDeviceType="ARM Compatible->ARM Cortex", SystemTargetFile="ert.tlc", HardwareBoard="Raspberry Pi", TargetLang="C")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
Simulation = Simulink.ConfigSet(StartTime="0", StopTime="inf", FixedStep="tS", Solver="FixedStepDiscrete", ProdHWDeviceType="Generic->32-bit x86 compatible", SystemTargetFile="slrt.tlc", TargetLang="C")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
Active = Simulink.ConfigSet(StartTime="0", StopTime="inf", FixedStep="tS", Solver="FixedStepDiscrete", ProdHWDeviceType="Generic->32-bit x86 compatible", SystemTargetFile="grt.tlc", TargetLang="C")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
tS = Simulink.Parameter(0.004)