% Simulink data dictionary UDPPortConfig.sldd

TPARTSend_Port = 22111
V2XSend_Port = 3002
VisualLocalizationSend_Port = 44440
VisualLocalizationRcv_Port = 44441
BehaviorStatemachineRcv_Port = 47101
BehaviorStatemachineSend_Port = 47100
TrajectoryGenerationSend_Port = 47102
PerformanceTrajectoryRcv_Port = 47103
EmergencyPathRcv_Port = 47104
ControllerLearningSend_Port = 47105
LocalTrajPlannerSend_Port = 47106
ObjTrackingSend_Port = 47107
TrajectoryGenerationRcv_Port = 47108
MapReferencesRcv_Port = 47109
TPASend_Port = 47108