% Simulink data dictionary pa_mvdc_curvvel_tracking.sldd

P_VDC_LatDeltaMaxFB_rad = Simulink.Parameter(0.2, Min=0)
P_VDC_LatDeltaMinFB_rad = Simulink.Parameter(-0.2, Max=0)
P_VDC_EnterStandstillThreshhold_mps = Simulink.Parameter(0.8)
P_VDC_LatDeltaMaxFF_rad = Simulink.Parameter(0.35, Min=0)
P_VDC_LatDeltaMinFF_rad = Simulink.Parameter(-0.35, Max=0)
P_VDC_LatDeltaMaxDistComp_rad = Simulink.Parameter(0.1, Min=0)
P_VDC_LatDeltaMinDistComp_rad = Simulink.Parameter(-0.1, Max=0)
P_VDC_MaxSlopeDelta_radps = Simulink.Parameter(5)
P_VDC_MinSlopeDelta_radps = Simulink.Parameter(-5)
P_VDC_FxMaxDistComp_N = Simulink.Parameter(5000, Min=0)
P_VDC_FxMinDistComp_N = Simulink.Parameter(-5000, Max=0)
P_VDC_FxMaxFB_N = Simulink.Parameter(3000, Min=0)
P_VDC_FxMaxFF_N = Simulink.Parameter(15000, Min=0)
P_VDC_FxMinFB_N = Simulink.Parameter(-3000, Max=0)
P_VDC_FxMinFF_N = Simulink.Parameter(-15000, Max=0)
P_VDC_NegativeFxStandstill_N = Simulink.Parameter(-2000, Max=0)
P_VDC_LongKp = Simulink.Parameter(1000, Min=0)
P_VDC_FxMinSlope_Nps = Simulink.Parameter(-300000, Max=0)
P_VDC_FxMaxSlope_Nps = Simulink.Parameter(300000, Min=0)
P_VDC_FxMaxDistFF_N = Simulink.Parameter(6000, Min=0)
P_VDC_FxMinDistFF_N = Simulink.Parameter(-6000, Max=0)
P_VDC_EmergencyBrakeAcceleration_mps2 = Simulink.Parameter(-10, Max=0)
P_VDC_UndersteerCompensationLowPassActive_b = Simulink.Parameter(true, DataType="boolean")
P_VDC_UndersteerGradient = Simulink.Parameter(0.0016)
P_VDC_UndersteerCompensationActive_b = Simulink.Parameter(false, DataType="boolean")
P_VDC_LowPassUSCT1 = Simulink.Parameter(0.08)
P_VDC_VelCon_vMaxStatic_mps = Simulink.Parameter(70)
P_VDC_CurvKp = Simulink.Parameter(0.3, Min=0)
P_VDC_UseManualFF = Simulink.Parameter(false, DataType="boolean")
P_VDC_FullControlSpeed_mps = Simulink.Parameter(0.3)
P_VDC_SlowControlSpeed_mps = Simulink.Parameter(0, Min=0)
P_VDC_VelDistFBActive = Simulink.Parameter(true, DataType="boolean")
P_VDC_VelDistFFActive = Simulink.Parameter(true, DataType="boolean")
P_VDC_VelDistEst_PT1_s = Simulink.Parameter(1)
P_VDC_CurvDistEst_PT1_s = Simulink.Parameter(1)
P_VDC_CurvDistActive = Simulink.Parameter(true, DataType="boolean")
P_VDC_SCLearn_LengthScales = Simulink.Parameter([0.04 5])
P_VDC_SCLearn_Sigma = Simulink.Parameter(0.01)
P_VDC_SCLearn_FilterCoeff = Simulink.Parameter(0.995)
P_VDC_SCLearn_KappaMax_radpm = Simulink.Parameter(0.13)
P_VDC_SCLearn_vMax_mps = Simulink.Parameter(60)
P_VDC_NonlinCurvDeltaActive_b = Simulink.Parameter(false, DataType="boolean")