% Simulink data dictionary pa_mvdc_path_matching.sldd

P_VDC_LocalFFCalculationActive_b = Simulink.Parameter(false, DataType="boolean")
P_VDC_PathMatchingTimeOut = Simulink.Parameter(0.5)
P_VDC_EnableLocalEMTrajectory_b = Simulink.Parameter(true, DataType="boolean")
P_VDC_LateralPathDeviationDerMax_mps = Simulink.Parameter(10)
P_VDC_LateralPathDeviationMax_m = Simulink.Parameter(3)
P_VDC_EnableSafetyChecks = Simulink.Parameter(true, DataType="boolean")
P_VDC_FinalSpeedEmergency_mps = Simulink.Parameter(0.5)