% Simulink data dictionary pa_vehicleparameter.sldd

WheelInertia_Front_kgm2 = 2
roh_air = Simulink.Parameter(1.22)
A_VehicleReference_m2 = Simulink.Parameter(1)
P_VDC_MinVelSlipCalc_mps = Simulink.Parameter(3)
cL_front = 1
cL_rear = 1.2
cog_x = 1.4
cog_y = 0
drag_coefficient = 2.3
gearratio = 4
l_front_m = 1.4
l_rear_m = 2
tw_front_m = 1.7
tw_rear_m = 1.7
tyre_width_F = 0.4
tyre_width_R = 0.4
tyreradius_front_m = 0.42
tyreradius_rear_m = 0.42
vehicleinertia_kgm2 = 1500
vehiclemass_kg = 1300
WheelInertia_Rear_kgm2 = 2
cog_z = 0.4
A_BrakePadF_m2 = Simulink.Parameter(0.004875)
A_BrakePadR_m2 = Simulink.Parameter(0.004875)
Brake2TractionForceWheel_F_Npbar = Simulink.Parameter(0)
Brake2TractionForceWheel_R_Npbar = Simulink.Parameter(0)
c_SpringF_Npm = Simulink.Parameter(193000)
c_SpringR_Npm = Simulink.Parameter(219000)
Crr_RollingResistanceF = Simulink.Parameter(0.012)
Crr_RollingResistanceR = Simulink.Parameter(0.015)
m_tireF_kg = Simulink.Parameter(20)  % not verified
m_tireR_kg = Simulink.Parameter(25)  % not verified

motionratio_WheelArbF = Simulink.Parameter(1.05)  % from excel-file 'Devbot-Parameters_V04.xlsx';
  % values are not given specifically and
  % are therefore taken from damper motion ratios
  % --> have to be verified

motionratio_WheelArbR = Simulink.Parameter(1.45)  % from excel-file 'Devbot-Parameters_V04.xlsx';
  % values are not given specifically and
  % are therefore taken from damper motion ratios
  % --> have to be verified

motionratio_WheelDamperF = Simulink.Parameter(1.05)  % from excel-file 'Devbot-Parameters_V04.xlsx'
motionratio_WheelDamperR = Simulink.Parameter(1.45)  % from excel-file 'Devbot-Parameters_V04.xlsx'

motionratio_WheelSpringF = Simulink.Parameter(1.05)  % from excel-file 'Devbot-Parameters_V04.xlsx';
  % values are not given specifically and
  % are therefore taken from damper motion ratios
  % --> have to be verified

motionratio_WheelSpringR = Simulink.Parameter(1.45)  % from excel-file 'Devbot-Parameters_V04.xlsx';
  % values are not given specifically and
  % are therefore taken from damper motion ratios
  % --> have to be verified

mue_BrakePadsDisc = Simulink.Parameter(0.6)
P_VDC_MinVelSlipCalc_mps1 = Simulink.Parameter(3)
r_Brake2WheelcenterF_m = Simulink.Parameter(0.1493)
r_Brake2WheelcenterR_m = Simulink.Parameter(0.1493)